# Grasshopper definition SunlightHoursAvailability_Analysis_LB.gh (Grasshopper 0.9.76)
# plug-ins: Python Interpreter

_3 = Step3()
_0 = Step0()
_1 = Step1()
# Sun Plot Time Period
_2 = Step2()
_4 = Step4()
# Select geometry for analysis in Rhino and then right click on "Buildings" and choose to set either "one Brep" or "Multiple Breps"
long_panel_header = Panel("Set Project Geometry")
long_panel_header_2 = Panel("Run Analysis")
_2e_set_sun_path_scale = Slider(0.2, range=0..20)
use_multiple_cpus = BooleanToggle(True)
bake_scene_to_rhino = BooleanToggle(True)
# Title Header: 2a: Provide input for analysis time period by setting
# 
# >>Hour(s)
# >>Day(s)
# >>Month(s)
# >>Sun Path Scale to Fit Your Scene
# You can provide an input for the day to add additional sun path diagram plots for the study.
_2b_set_the_number_of_hours = Slider(24, range=0..100)
_4a_run_simulation = BooleanToggle(False)

# ---- group: 3d: Enable North Arrow
pt = Point(Point(2309.239782, -241.8363496, 0))
northarrow = Ladybug_North(centerPt=pt)  # -> northSign; plug-in component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

# ----
# Sunlight Availability Hours Script Version 1.0
# 
# ::This script allows for an understanding of the length of time that specific surfaces have an exposure to solar radiation.
# 
# Tyrone Marshall
panel = Panel("ENERGY LAB")
# Data: 1a:
# >>Left Click on the "Toggle" node
# 
# >>Use a weather file from the Energy Lab weather file repository:
# 
# \\perkinswill.net\PWresources\Research\Energy_Lab\Github\energylab_github\Energy-Lab\data_weather\TMY_EPW_STAT_DDY
long_panel_header_3 = Panel("Load Weather File")
# Drop LadyBug Node on Canvas
# This scene comes with a Rhino scene that has been internalized into the GH script.  This means that you can just use this script and have a test scene included for your analysis.
ladybug = Ladybug_Ladybug()  # -> Vviiiiiiiiiizzz; plug-in component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
special_data_panel = Panel("3c")
# GridSize Settings
# 5 for Good Quality
# 30-50 for Rough Quality
number_slider = Slider(0.295, range=0..1)
open_weather_file = Ladybug_OpenEPWWeatherFile(open=Toggle(False))  # -> epwFile; plug-in component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

# ---- group: 3a: Set Design Structures
buildings = Brep([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])
wires = BrepWireframe(Brep=buildings, Density=-1)
preview = CustomPreview(Geometry=wires, Shader=ColourSwatch(SwatchColor=RGB(0, 0, 0)))

# ---- group: 2d: Set Month(s)
panel_2 = Panel("9")

# ---- group: 2c: Set Day(s)
panel_3 = Panel("30")

# ----
legendpar = Ladybug_LegendParameters(
    lowBound="0",
    highBound=Slider(11, range=0..24),
    numSegments=Slider(5, range=0..24),
    customColors=flatten([ColourSwatch(SwatchColor=RGB(0, 0, 0)), ColourSwatch(SwatchColor=RGB(255, 255, 255))]))  # -> legendPar; plug-in component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
series = Series(Start=0, Step=1, Count=_2b_set_the_number_of_hours)
confirmation_number_of_hours = Panel(series)

# ---- group: 3b: Set Ground and Turn Off Display
# Select geometry for ground surface in Rhino and then right click on "Ground" and choose to set as "one Brep"
ground = Brep(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)

# ----
importepw = Ladybug_ImportEpw(epwFile=open_weather_file)  # -> readMe, latitude, location, dryBulbTemperature, dewPointTemperature, relativeHumidity, windSpeed, windDirection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; plug-in component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
sunpath = Ladybug_SunPath(
    location=importepw.location,
    hour=series,
    day=panel_3,
    month=panel_2,
    timeStep=1,
    sunPathScale=_2e_set_sun_path_scale,
    dailyOrAnnualSunPath=True)  # -> readMe, sunVectors, sunAltitudes, sunAzimuths, port, sunSpheresMesh, sunPathCrvs, legend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; plug-in component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
sunlighthoursanalysis = Ladybug_SunlightHoursAnalysis(
    geometry=flatten([buildings, ground]),
    gridSize=Slider(30, range=0..100),
    disFromBase=number_slider,
    sunVectors=flatten(sunpath.sunVectors),
    timeStep=1,
    legendPar=flatten(legendpar),
    parallel=use_multiple_cpus,
    runIt=_4a_run_simulation,
    bakeIt=bake_scene_to_rhino)  # -> readMe, contextMesh, analysisMesh, testPts, testVec, port, sunlightHoursResult, sunlightHoursMesh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; plug-in component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

# ---- group: 4b: Enable to Show Analysis Points
pt_2 = Point(sunlighthoursanalysis.testPts)

# ----
mesh = Mesh(sunlighthoursanalysis.sunlightHoursMesh)
geo = Geometry(sunlighthoursanalysis.sunlightHoursLegend)
confirmation_location_data = Panel(sunpath.readMe)

# ---- group: 2f: View Project SunPath As Flat Projection
# Enable this node to view Sun Path as a Flat Projection
project = Project(Geometry=sunpath.sunPathCrvs, Plane=PlaneXY(0, 0, 0))  # -> Geometry, Transform

# ----
weather_file_load_status = Panel(importepw.readMe)
